# Grasshopper definition Preview Classification.gh (Grasshopper 1.0.7)
# plug-ins: LunchBox, Grasshopper-Tekla Link 2022.1.16, Wombat, Human UI

panel = Panel("""Value1
Value2
Value3""")
panel_2 = Panel("""Value1
Value2
Value3""")
panel_3 = Panel("""Value1
Value2
Value3""")
toggle = CreateToggle(Default=False, Label="Property Sets")
create_file_picker = CreateFilePicker(ButtonLabelText="Result File", DialogType=0, MustExist=True, Filter="All Files|*.*")
panel_4 = Panel("""0
3
4
1
2""")
create_checklist = CreateChecklist(ChecklistItems=panel, Selected=False)
create_checklist_2 = CreateChecklist(ChecklistItems=panel_2, Selected=False)
button = CreateButton(ButtonName="Select objects", ButtonStyle=0)
create_checklist_3 = CreateChecklist(ChecklistItems=panel_3, Selected=False)
value_listener = ValueListener(Elements=toggle, SomeProperty=True)  # -> Values, Indices
value_listener_2 = ValueListener(Elements=create_file_picker, SomeProperty=True)  # -> Values, Indices
file_path = FilePath(value_listener_2.Values)
read_file = ReadFile(File=file_path, PerLineParse=True)
read_csv = ReadCSV(CSVString=read_file, Delimiter=";")  # -> Headers, Values
tree_branch = TreeBranch(Tree=read_csv.Values, Path=panel_4, MaintainPaths=False)
branch = TreeBranch(Tree=tree_branch, Path="0", MaintainPaths=True)
eval = Evaluate(F="contains(a,\"MISTAKE\")", a=branch)
label = CreateLabel(LabelText="MISTAKES", LabelSize=12, Justification=0)
label_2 = CreateLabel(LabelText="RESULTS", LabelSize=12, Justification=0)
dispatch = Dispatch(List=tree_branch, DispatchPattern=eval)  # -> ListA, ListB
value_listener_3 = ValueListener(Elements=button, SomeProperty=True)  # -> Values, Indices
launch_window = LaunchWindow(Show=Toggle(True), Name="Classification Results", Width=370, Height=400, ChildStatus=2, EnableHorizScroll=False)
value_listener_4 = ValueListener(Elements=create_checklist, SomeProperty=True)  # -> Values, Indices
value_listener_5 = ValueListener(Elements=create_checklist_2, SomeProperty=True)  # -> Values, Indices
value_listener_6 = ValueListener(Elements=create_checklist_3, SomeProperty=True)  # -> Values, Indices
selected_types = Data(value_listener_4.Values)
selected_types_2 = Data(value_listener_5.Values)
selected_types_3 = Data(value_listener_6.Values)
explode_tree = ExplodeTree(Data=dispatch.ListB)  # -> Branch0, Branch1, Branch2, Branch3, Branch4
merge = Merge(
    Data1=create_file_picker,
    Data2=toggle,
    Data3=button,
    Data4=label,
    Data5=create_checklist_2,
    Data6=label_2,
    Data7=create_checklist)
add_elements = AddElements(Window=launch_window, Elements=flatten(merge), DoVLChecking=True)  # -> AddedElements, ElementNames
split = TextSplit(Text=explode_tree.Branch0, Separators="|")
eval_2 = Evaluate(F="contains(a,\"PropertySet\")", a=split)
cull = CullPattern(List=split, CullPattern=invert(eval_2))
point = Point(explode_tree.Branch1)
point_2 = Point(explode_tree.Branch2)
join = TextJoin(Text=cull, Join="|")  # -> flatten(Result)
filter = StreamFilter(Gate=value_listener.Values, Stream0=join, Stream1=explode_tree.Branch0)
create_set = CreateSet(List=filter)  # -> Set, Map
tsort = SortText(Keys=create_set.Set, Culture=127)  # -> Keys, Values
lng = ListLength(List=tsort.Keys)
series = Series(Start="1", Step=1, Count=lng)
mindex = MemberIndex(Set=filter, Member=tsort.Keys)  # -> Index, Count
line = Line(StartPoint=point, EndPoint=point_2)
format = Format(Format="{0} x {1}", Culture=127, Data0=mindex.Count, Data1=tsort.Keys)
connection_types = Data(format)
connection_types_2 = Data(connection_types)
connection_types_3 = Data(connection_types)
set_checklist_contents = SetChecklistContents(ChecklistToModify=create_checklist, NewChecklistContents=connection_types_2)
set_checklist_contents_2 = SetChecklistContents(ChecklistToModify=create_checklist_3, NewChecklistContents=connection_types_3)
selected_types_4 = Data(selected_types)
cull_pattern = CullPattern(List=tsort.Keys, CullPattern=selected_types_4)
member_index = MemberIndex(Set=filter, Member=cull_pattern)  # -> Index, Count
random_color = RandomColor(Data=cull_pattern, Seed="10", FastMode=False)  # -> graft(Colors)
cull_pattern_2 = CullPattern(List=series, CullPattern=selected_types_4)  # -> graft(List)
list_item = ListItem(List=explode_tree.Branch4, Index=member_index.Index, Wrap=True)  # -> simplify(Item)
list_item_2 = ListItem(List=explode_tree.Branch3, Index=member_index.Index, Wrap=True)  # -> simplify(Item)
list_item_3 = ListItem(List=line, Index=member_index.Index, Wrap=True)  # -> simplify(Item)
panel_5 = Panel(random_color)
larger_than = LargerThan(FirstNumber=list_item_3, SecondNumber="100")  # -> LargerThan, OrEqualTo
merge_2 = Merge(Data1=list_item_2, Data2=list_item)
getg = GetObjectByGuid(Guid=list_item, ToleranceMm=0.6)
getg_2 = GetObjectByGuid(Guid=list_item_2, ToleranceMm=0.6)
explode_tree_2 = ExplodeTree(Data=dispatch.ListA)  # -> Branch0, Branch1, Branch2, Branch3, Branch4
position = Position(Plane=0, Rotation=0, Depth=0, Position="Center, Mid", ToleranceMm=0.6)
cull_pattern_3 = CullPattern(List=list_item_3, CullPattern=larger_than.LargerThan)
C = ComponentCatalog(CNumber=0, CType="UNKNOWN", ToleranceMm=0.6)
create_set_2 = CreateSet(List=explode_tree_2.Branch0)  # -> Set, Map
point_3 = Point(explode_tree_2.Branch1)
point_4 = Point(explode_tree_2.Branch2)
list_length = ListLength(List=cull_pattern_3)
component = Component(
    Name=C,
    Remove_when_input_is_empty=False,
    Remove_while_inputs_are_being_modified=True,
    Run_in_background=True,
    ToleranceMm=0.6)
tsort_2 = SortText(Keys=create_set_2.Set, Culture=127)  # -> Keys, Values
duplicate_data = DuplicateData(Data=graft(cull_pattern), Number=list_length, Order=True)
list_length_2 = ListLength(List=duplicate_data)
duplicate_data_2 = DuplicateData(Data=cull_pattern_2, Number=list_length_2, Order=True)  # -> flatten(Data)
lng_2 = ListLength(List=tsort_2.Keys)
series_2 = Series(Start="1", Step=1, Count=lng_2)
mindex_2 = MemberIndex(Set=explode_tree_2.Branch0, Member=tsort_2.Keys)  # -> Index, Count
class = Data(duplicate_data_2)
part_attributes = PartAttributes(Name=duplicate_data, Class="2", ToleranceMm=0.6)
beam = Beam(
    Curve=cull_pattern_3,
    Profile="D300",
    Attributes=part_attributes,
    Position=position,
    Remove_when_input_is_empty=True,
    Remove_while_inputs_are_being_modified=False,
    Run_in_background=True,
    ToleranceMm=0.6)
line_2 = Line(StartPoint=point_3, EndPoint=point_4)
format_2 = Format(Format="{0} x {1}", Culture=127, Data0=mindex_2.Count, Data1=tsort_2.Keys)
connection_types_4 = Data(format_2)
connection_types_5 = Data(connection_types_4)
set_checklist_contents_3 = SetChecklistContents(ChecklistToModify=create_checklist_2, NewChecklistContents=connection_types_5)
selected_types_5 = Data(selected_types_2)
cull_pattern_4 = CullPattern(List=tsort_2.Keys, CullPattern=selected_types_5)
member_index_2 = MemberIndex(Set=explode_tree_2.Branch0, Member=cull_pattern_4)  # -> Index, Count
random_color_2 = RandomColor(Data=cull_pattern_4, Seed="10", FastMode=False)  # -> graft(Colors)
cull_pattern_5 = CullPattern(List=series_2, CullPattern=selected_types_5)  # -> graft(List)
list_item_4 = ListItem(List=explode_tree_2.Branch4, Index=member_index_2.Index, Wrap=True)  # -> simplify(Item)
list_item_5 = ListItem(List=explode_tree_2.Branch3, Index=member_index_2.Index, Wrap=True)  # -> simplify(Item)
list_item_6 = ListItem(List=line_2, Index=member_index_2.Index, Wrap=True)  # -> simplify(Item)
larger_than_2 = LargerThan(FirstNumber=list_item_6, SecondNumber="100")  # -> LargerThan, OrEqualTo
panel_6 = Panel(random_color_2)
merge_3 = Merge(Data1=list_item_5, Data2=list_item_4)
position_2 = Position(Plane=0, Rotation=0, Depth=0, Position="Center, Mid", ToleranceMm=0.6)
cull_pattern_6 = CullPattern(List=list_item_6, CullPattern=larger_than_2.LargerThan)
list_length_3 = ListLength(List=cull_pattern_6)
duplicate_data_3 = DuplicateData(Data=graft(cull_pattern_4), Number=list_length_3, Order=True)
list_length_4 = ListLength(List=duplicate_data_3)
duplicate_data_4 = DuplicateData(Data=cull_pattern_5, Number=list_length_4, Order=True)  # -> flatten(Data)
class_2 = Data(duplicate_data_4)
part_attributes_2 = PartAttributes(Name=duplicate_data_3, Class="2", ToleranceMm=0.6)
beam_2 = Beam(
    Curve=cull_pattern_6,
    Profile="D300",
    Attributes=part_attributes_2,
    Position=position_2,
    Remove_when_input_is_empty=True,
    Remove_while_inputs_are_being_modified=False,
    Run_in_background=True,
    ToleranceMm=0.6)
merge_4 = Merge(Data1=beam, Data2=beam_2)
mo = ModelObject(merge_4)
object_selector = CSharpScript(
    modelObjects=flatten(mo),
    activate=value_listener_3.Values,
    Reference=["C:\Program Files\Tekla Structures\2022.0\bin\Tekla.Structures.dll", "C:\Program Files\Tekla Structures\2022.0\bin\Tekla.Structures.Model.dll", "C:\Program Files\Tekla Structures\2022.0\bin\Tekla.Application.Library.dll"])  # -> Results, TeklaPartsOut, A, B; inputs modelObjects: list, activate: Boolean
# ---------- object_selector: C# usings ----------
using Tekla.Structures;
using TSM = Tekla.Structures.Model;
using T3D = Tekla.Structures.Geometry3d;
# ---------- object_selector: C# ----------
    if(activate){
    
      var temp = new ArrayList(modelObjects);
      new Tekla.Structures.Model.UI.ModelObjectSelector().Select(temp);

    }
# ---------- end object_selector ----------
